# Grasshopper definition case-v1.gh (Grasshopper 1.0.7)

screw_centers = Point([Point(37.10315819, 90.59634016, 0), Point(19.10316019, 60.59634016, 0), Point(9.103159193, 32.59634016, 0), Point(51.10315919, 15.59634016, 0), Point(86.10315919, 31.59634016, 0), Point(97.10315919, 86.59634016, 0), Point(58.08245919, 77.68144016, 0), Point(61.40315919, 39.72634016, 0)])
bottom_part_thickness = Number(2.1)
pcb_outline = Curve(<curve referenced from the Rhino model>)
bottom_plate_thickness = Number(1)
case_tolerance = Number(0.5)
screw_centers_2 = Point(screw_centers)
cluster = Cluster_4(screw_holes=screw_centers)
cluster_2 = Cluster_6(pcb_outline=pcb_outline, case_tolerance=case_tolerance, case_thickness=Slider(1.5, range=0..10))  # -> case_inner_boundary_2, case_outer_boundary_2
raised_area_height = Slider(5.5, range=0..10)
raised_area_ceiling = Slider(1.5, range=0..10)
raised_area_inner_edges = Curve(<curve referenced from the Rhino model>)
raised_area_outline = Curve(<curve referenced from the Rhino model>)
plate_thickness = Number(4)
bottom_plate = BottomPlate(
    screw_holes=screw_centers_2,
    pcb_outline=pcb_outline,
    bottom_part_thickness=bottom_part_thickness,
    bottom_plate_thickness=bottom_plate_thickness)
angledswitches = Point([Point(18.51650919, 16.56764016, 0), Point(35.90310919, 21.22634016, 0)])
straigh_switches = Point([Point(30.40315919, 78.72634016, 0), Point(30.40315919, 61.72634016, 0), Point(30.40315919, 44.72634016, 0), Point(48.40315919, 46.72634016, 0), Point(48.40315919, 63.72634016, 0), Point(48.40315919, 80.72634016, 0), Point(66.40315919, 86.72634016, 0), Point(66.40315919, 69.72634016, 0), Point(66.40315919, 52.72634016, 0), Point(84.40315919, 46.72634016, 0), Point(84.40315919, 63.72634016, 0), Point(84.40315919, 80.72634016, 0), Point(102.4031592, 74.72634016, 0), Point(102.4031592, 57.72634016, 0), Point(102.4031592, 40.72634016, 0), Point(55.50315919, 26.92634016, 0)])
cluster_3 = Cluster_3(
    plate_thickness=plate_thickness,
    case_outer_boundary=cluster_2.case_outer_boundary_2,
    case_inner_boundary=cluster_2.case_inner_boundary_2,
    raised_area_outer_edges=raised_area_outline,
    raised_area_inner_edges=raised_area_inner_edges,
    A=raised_area_height,
    F=raised_area_ceiling)  # -> raised_area_hollow_2, raised_enclosure_2
thread_hole_depth = Slider(3.5, range=0..10)
pcb_thickness = Number(1.6)
cluster_4 = Cluster_5(straigh_switches=straigh_switches, angledswitches=angledswitches, switch_hole_size=Slider(15.5, range=0..100))
carve_out_length = Slider(10, range=0..10)
cluster_5 = Cluster_7(
    E=cluster_2.case_outer_boundary_2,
    E_2=cluster_2.case_inner_boundary_2,
    thread_hole_depth=thread_hole_depth,
    switch_holes=cluster_4,
    thread_holes=cluster,
    plate_thickness=plate_thickness,
    pcb_thickness=pcb_thickness,
    bottom_part_thickness=bottom_part_thickness,
    bottom_plate_thickness=bottom_plate_thickness,
    raised_area_hollow=cluster_3.raised_area_hollow_2)  # -> lid_2, bulk_2, skirt_2
controller_mid_on_pcb = Point(Point(9.403159193, 87.22634016, 0))
trrs_mid_on_pcb = Point(Point(3.679473193, 60.75978016, 0))
usb_hole = Curve(<curve referenced from the Rhino model>)
cluster_6 = Cluster_2(controller_mid_on_pcb=controller_mid_on_pcb, usb_hole=usb_hole, F=carve_out_length)
cluster_7 = Cluster(trrs_mid_on_pcb=trrs_mid_on_pcb, F=carve_out_length)
merge = Merge(Data1=cluster_5.lid_2, Data2=cluster_5.bulk_2, Data3=cluster_5.skirt_2, Data4=cluster_3.raised_enclosure_2)
dam = DataDam(DataA=merge, BufferDelay=10000000, BufferMode=0)
sunion = SolidUnion(Breps=flatten(dam))
top = Geometry(sunion)
carve_outs = Geometry([cluster_7, cluster_6])
bottom = Geometry(bottom_plate)

# ==== cluster BottomPlate
bottom_part_thickness = ClusterInput()
pcb_outline = ClusterInput()
bottom_plate_thickness = ClusterInput()
screw_holes = ClusterInput()
bottom_part_thickness_2 = Number(bottom_part_thickness)
pcb_outline_2 = Curve(pcb_outline)
bottom_plate_thickness_2 = Number(bottom_plate_thickness)
m2_durchgangsloch = Number(2.2)
screw_boss_diam_diff = Number(1.4)
screw_holes_2 = Point(screw_holes)
vec = VectorXYZ(XComponent=Slider(1, range=0..1), YComponent=0, ZComponent=expr("x*-1", bottom_plate_thickness_2))  # -> Vector, Length
addition = Addition(A=screw_boss_diam_diff, B=m2_durchgangsloch)
cir = Circle(Plane=screw_holes_2, Radius=expr("x/2", m2_durchgangsloch))
cir_2 = Circle(Plane=screw_holes_2, Radius=expr("x/2", addition))
Z = UnitZ(Factor=expr("x*-1", bottom_part_thickness_2))
end = EndPoints(Curve=cir)  # -> Start, End
boundary = BoundarySurfaces(Edges=cir)
boundary_2 = BoundarySurfaces(Edges=pcb_outline_2)
boundary_3 = BoundarySurfaces(Edges=cir_2)
move = Move(Geometry=end.Start, Motion=vec.Vector)  # -> Geometry, Transform
flip = Flip(Surface=boundary_2)  # -> Surface, Result
ln = Line(StartPoint=end.Start, EndPoint=move.Geometry)
sdiff = SolidDifference(BrepsA=boundary_3, BrepsB=boundary)
sdiff_2 = SolidDifference(BrepsA=flip.Surface, BrepsB=boundary)
move_2 = Move(Geometry=sdiff_2, Motion=Z)  # -> Geometry, Transform
extr = Extrude(Base=sdiff, Direction=Z)
Z_2 = UnitZ(Factor=expr("x*-1", bottom_plate_thickness_2))
swp1 = Sweep1(Rail=graft(cir), Sections=graft(ln), Miter=1)
extr_2 = Extrude(Base=move_2.Geometry, Direction=Z_2)
cap = CapHoles(Brep=swp1)
Z_3 = UnitZ(Factor=expr("x*-1", bottom_part_thickness_2))
move_3 = Move(Geometry=cap, Motion=Z_3)  # -> flatten(Geometry), Transform
sdiff_3 = SolidDifference(BrepsA=extr_2, BrepsB=move_3.Geometry)
sunion = SolidUnion(Breps=[extr, sdiff_3])
bottom_plate = ClusterOutput(sunion)

# ==== cluster Cluster
trrs_mid_on_pcb = ClusterInput()
trrs_mid_on_pcb_2 = Point(trrs_mid_on_pcb)
number_slider = Slider(2.5, range=0..10)
X = UnitX(Factor=1)
Z = UnitZ(Factor=number_slider)
move = Move(Geometry=trrs_mid_on_pcb_2, Motion=Z)  # -> Geometry, Transform
circle = CircleCNR(Center=move.Geometry, Normal=X, Radius=number_slider)
F = ClusterInput()
X_2 = UnitX(Factor=expr("x*-1", F))
extr = Extrude(Base=circle, Direction=X_2)
cap = CapHoles(Brep=extr)
trrs_carve_out = Geometry(cap)
trrs_carve_out_2 = ClusterOutput(trrs_carve_out)

# ==== cluster Cluster_2
controller_mid_on_pcb = ClusterInput()
usb_hole = ClusterInput()
controller_mid_on_pcb_2 = Point(controller_mid_on_pcb)
usb_hole_2 = Curve(usb_hole)
area = Area(Geometry=usb_hole_2)  # -> Area, Centroid
xz = XZPlane(Origin=controller_mid_on_pcb_2)
Z = UnitZ(Factor=Slider(2.75, range=0..10))
move = Move(Geometry=xz, Motion=Z)  # -> Geometry, Transform
orient = Orient(Geometry=usb_hole_2, Source=area.Centroid, Target=move.Geometry)  # -> Geometry, Transform
F = ClusterInput()
Y = UnitY(Factor=F)
extr = Extrude(Base=orient.Geometry, Direction=Y)
cap = CapHoles(Brep=extr)
usb_carve_out = Geometry(cap)
usb_carve_out_2 = ClusterOutput(usb_carve_out)

# ==== cluster Cluster_3
raised_area_inner_edges = ClusterInput()
raised_area_outer_edges = ClusterInput()
case_inner_boundary = ClusterInput()
case_outer_boundary = ClusterInput()
plate_thickness = ClusterInput()
raised_area_inner_edges_2 = Curve(raised_area_inner_edges)
raised_area_outer_edges_2 = Curve(raised_area_outer_edges)
case_inner_boundary_2 = Curve(case_inner_boundary)
case_outer_boundary_2 = Curve(case_outer_boundary)
plate_thickness_2 = Number(plate_thickness)
move = Move(Geometry=raised_area_outer_edges_2, Motion="{-2, 2, 0}")  # -> Geometry, Transform
rint = RegionIntersection(CurvesA=case_outer_boundary_2, CurvesB=raised_area_outer_edges_2)
boundary = BoundarySurfaces(Edges=rint)
rint_2 = RegionIntersection(CurvesA=case_inner_boundary_2, CurvesB=raised_area_inner_edges_2)
raised_area = Geometry(boundary)
rdiff = RegionDifference(CurvesA=raised_area, CurvesB=rint_2)
raised_area_hollow = Geometry(rint_2)
A = ClusterInput()
raised_area_walls = Geometry(rdiff)
Z = UnitZ(Factor=plate_thickness_2)
raised_area_hollow_2 = ClusterOutput(raised_area_hollow)
subtraction = Subtraction(A=A, B=plate_thickness_2)
boundary_2 = BoundarySurfaces(Edges=raised_area_walls)
move_2 = Move(Geometry=boundary_2, Motion=Z)  # -> Geometry, Transform
Z_2 = UnitZ(Factor=subtraction)
extr = Extrude(Base=move_2.Geometry, Direction=Z_2)
addition = Addition(A=subtraction, B=plate_thickness_2)
cap = CapHoles(Brep=extr)
Z_3 = UnitZ(Factor=addition)
F = ClusterInput()
move_3 = Move(Geometry=raised_area, Motion=Z_3)  # -> Geometry, Transform
Z_4 = UnitZ(Factor=F)
extr_2 = Extrude(Base=move_3.Geometry, Direction=Z_4)
sunion = SolidUnion(Breps=[extr_2, cap])  # -> flatten(Result)
raised_enclosure = Geometry(sunion)
raised_enclosure_2 = ClusterOutput(raised_enclosure)

# ==== cluster Cluster_4
screw_holes = ClusterInput()
screw_holes_2 = Point(screw_holes)
m2_kernloch = Number(1.6)
cir = Circle(Plane=screw_holes_2, Radius=expr("x/2", m2_kernloch))
boundary = BoundarySurfaces(Edges=cir)
flip = Flip(Surface=boundary)  # -> Surface, Result
thread_holes = Geometry(flip.Surface)
thread_holes_2 = ClusterOutput(thread_holes)

# ==== cluster Cluster_5
straigh_switches = ClusterInput()
angledswitches = ClusterInput()
switch_hole_size = ClusterInput()
straigh_switches_2 = Point(straigh_switches)
angledswitches_2 = Point(angledswitches)
switch_hole_size_2 = Number(switch_hole_size)
xy = XYPlane(Origin=straigh_switches_2)
xy_2 = XYPlane(Origin=angledswitches_2)
prot = RotatePlane(Plane=xy_2, Angle=degrees(Slider(15, range=0..100)))
switch_planes = Geometry([xy, prot])
lng = ListLength(List=switch_planes)
xy_3 = XYPlane(Origin=Point(0, 0, 0))
repeat = RepeatData(Data=xy_3, Length=lng)
rectangle = Rectangle(Plane=repeat, XSize=switch_hole_size_2, YSize=switch_hole_size_2, Radius=Slider(0.5, range=0..1))  # -> Rectangle, Length
area = Area(Geometry=rectangle.Rectangle)  # -> Area, Centroid
xy_4 = XYPlane(Origin=area.Centroid)
orient = Orient(Geometry=rectangle.Rectangle, Source=xy_4, Target=switch_planes)  # -> Geometry, Transform
boundary = BoundarySurfaces(Edges=orient.Geometry)
flip = Flip(Surface=boundary)  # -> Surface, Result
switch_holes = Geometry(flip.Surface)
switch_holes_2 = ClusterOutput(switch_holes)

# ==== cluster Cluster_6
case_thickness = ClusterInput()
case_tolerance = ClusterInput()
pcb_outline = ClusterInput()
case_thickness_2 = Number(case_thickness)
case_tolerance_2 = Number(case_tolerance)
pcb_outline_2 = Curve(pcb_outline)
reb = RebuildCurve(Curve=pcb_outline_2, Degree=Slider(3, range=0..10), Count=Slider(200, range=0..1000), Tangents=False)
pcb_outline_3 = Curve(reb)
offset = OffsetCurve(Curve=pcb_outline_3, Distance=expr("x*-1", case_tolerance_2), Plane=PlaneXY(0, 0, 0), Corners=1)
offset_2 = OffsetCurve(Curve=offset, Distance=expr("x*-1", case_thickness_2), Plane=PlaneXY(0, 0, 0), Corners=1)
case_inner_boundary = Curve(offset)
case_outer_boundary = Curve(offset_2)
case_inner_boundary_2 = ClusterOutput(case_inner_boundary)
case_outer_boundary_2 = ClusterOutput(case_outer_boundary)

# ==== cluster Cluster_7
bottom_part_thickness = ClusterInput()
bottom_plate_thickness = ClusterInput()
plate_thickness = ClusterInput()
pcb_thickness = ClusterInput()
thread_holes = ClusterInput()
switch_holes = ClusterInput()
bottom_part_thickness_2 = Number(bottom_part_thickness)
bottom_plate_thickness_2 = Number(bottom_plate_thickness)
plate_thickness_2 = Number(plate_thickness)
pcb_thickness_2 = Number(pcb_thickness)
thread_holes_2 = Geometry(thread_holes)
switch_holes_2 = Geometry(switch_holes)
E = ClusterInput()
E_2 = ClusterInput()
addition = Addition(A=pcb_thickness_2, B=bottom_part_thickness_2, C=bottom_plate_thickness_2)
boundary = BoundarySurfaces(Edges=E)
boundary_2 = BoundarySurfaces(Edges=E_2)
raised_area_hollow = ClusterInput()
plate_solid = Curve(boundary)
raised_area_hollow_2 = Geometry(raised_area_hollow)
sdiff = SolidDifference(BrepsA=plate_solid, BrepsB=switch_holes_2)
sdiff_2 = SolidDifference(BrepsA=sdiff, BrepsB=raised_area_hollow_2)
thread_hole_depth = ClusterInput()
sdiff_3 = SolidDifference(BrepsA=sdiff_2, BrepsB=thread_holes_2)
plate_with_switch_holes = Geometry(sdiff_2)
Z = UnitZ(Factor=expr("x*-1", addition))
sdiff_4 = SolidDifference(BrepsA=plate_solid, BrepsB=boundary_2)
thread_hole_depth_2 = Number(thread_hole_depth)
plate_with_switch_and_thread_holes = Geometry(sdiff_3)
extr = Extrude(Base=sdiff_4, Direction=Z)
Z_2 = UnitZ(Factor=thread_hole_depth_2)
move = Move(Geometry=plate_with_switch_holes, Motion=Z_2)  # -> Geometry, Transform
subtraction = Subtraction(A=plate_thickness_2, B=thread_hole_depth_2)
extr_2 = Extrude(Base=plate_with_switch_and_thread_holes, Direction=Z_2)
Z_3 = UnitZ(Factor=subtraction)
extr_3 = Extrude(Base=move.Geometry, Direction=Z_3)
lid = Geometry(extr_3)
skirt = Geometry(extr)
bulk = Geometry(extr_2)
lid_2 = ClusterOutput(lid)
skirt_2 = ClusterOutput(skirt)
bulk_2 = ClusterOutput(bulk)
