# Grasshopper definition case-v2.gh (Grasshopper 1.0.7)

number_slider = Slider(1.6, range=0..10)

usbz_offset = Number(Slider(2.8, range=0..10))
usb_height = Number(Slider(7, range=0..10))
usb_width = Number(Slider(12, range=0..20))

bottom_parts_thickness = Number(Slider(2.1, range=0..10))
shoulder_height = Number(number_slider)
floor_thickness = Number(Slider(1.5, range=0..10))
pcb_thickness = Number(number_slider)

# ---- group: Input Geom
shoulder_cutout = Geometry(<curve referenced from the Rhino model>)
screw_centers = Point([Point(86.10315919, 31.59634016, 0), Point(97.10315919, 86.59634016, 0), Point(37.10315819, 90.59634016, 0), Point(19.10316019, 60.59634016, 0), Point(9.103159193, 32.59634016, 0), Point(51.10315969, 15.59634016, 0), Point(61.40315919, 39.72634016, 0), Point(40.76535919, 57.04354016, 0), Point(58.08245919, 77.68144016, 0)])
foot_centers = Point([Point(108.3803811, 79.57874418, 0), Point(108.1494271, 34.62483455, 0), Point(63.61095229, 91.61832727, 0), Point(15.99582033, 6.125709229, 0), Point(4.356357376, 83.64786037, 0)])
pcb_outline = Curve(<curve referenced from the Rhino model>)
ttrs_xy = Point(Point(-0.3123978382, 60.75978016, 0))

# ----
shoulder_width = Number(Slider(3, range=0..10))
case_tolerance = Number(Slider(1, range=0..1))
pcb_shoulder = Number(Slider(1.5, range=0..10))

trrs_barrel_diam = Number(Slider(7, range=0..10))
trrs_z_offset = Number(Slider(2.6, range=0..10))

standoff_diam = Number(Slider(7, range=0..10))
thread_length = Number(Slider(3.4, range=0..10))
insert_tip_diam = Number(Slider(2.8, range=0..10))

usb_xy = Point(Point(9.403159193, 87.22634016, 0))

foot_diam = Number(Slider(8, range=0..10))
foot_inset = Number(Slider(1.2, range=0..3))

outer_case_outline = OuterCaseOutline(pcb_outline=pcb_outline, shoulder_width=shoulder_width, case_tolerance=case_tolerance)
foot_centers_2 = Point(foot_centers)
pcb_shoulder_2 = PCBShoulder(
    pcb_outline=pcb_outline,
    pcb_shoulder=pcb_shoulder,
    bottom_parts_thickness=bottom_parts_thickness,
    outer_case_outline=outer_case_outline)
cluster = Cluster_4(usb_xy=usb_xy, usb_height=usb_height, usb_width=usb_width, usbz_offset=usbz_offset)
foot_diam_2 = Number(foot_diam)
foot_inset_2 = Number(foot_inset)
cluster_2 = Cluster(
    bottom_parts_thickness=bottom_parts_thickness,
    screw_centers=screw_centers,
    standoff_diam=standoff_diam,
    insert_tip_diam=insert_tip_diam,
    thread_length=thread_length)  # -> E, E_2
cir = Circle(Plane=foot_centers_2, Radius=expr("x/2", foot_diam_2))
boundary = BoundarySurfaces(Edges=cir)
outer_case_outline_2 = Geometry(outer_case_outline)
floor_thickness_2 = Number(floor_thickness)
cluster_3 = Cluster_3(trrs_barrel_diam=trrs_barrel_diam, trrs_z_offset=trrs_z_offset, ttrs_xy=ttrs_xy)
cluster_4 = Cluster_2(shoulder_cutout=shoulder_cutout, bottom_parts_thickness=bottom_parts_thickness)
Z = UnitZ(Factor=foot_inset_2)
extr = Extrude(Base=boundary, Direction=Z)
boundary_2 = BoundarySurfaces(Edges=outer_case_outline_2)
case_shoulder = CaseShoulder(
    outer_case_outline=outer_case_outline,
    pcb_outline=pcb_outline,
    shoulder_height=shoulder_height,
    case_tolerance=case_tolerance,
    pcb_thickness=pcb_thickness)
Z_2 = UnitZ(Factor=floor_thickness_2)
extr_2 = Extrude(Base=boundary_2, Direction=Z_2)

case_shoulder_2 = Geometry(case_shoulder)
pcb_shoulder_3 = Geometry(pcb_shoulder_2)
thread_holes = Geometry(cluster_2.E_2)
stand_offs = Geometry(cluster_2.E)
shoulder_cutout_2 = Geometry(cluster_4)
trrs_cutout = Geometry(cluster_3)
floor = Geometry(extr_2)
foot_cut_outs = Geometry(extr)

usb_cutout = Geometry(cluster)

bottom_parts_thickness_2 = Number(bottom_parts_thickness)
floor_thickness_3 = Number(floor_thickness)
pcb_thickness_2 = Number(pcb_thickness)

addition = Addition(A=floor_thickness_3, B=bottom_parts_thickness_2)
Z_3 = UnitZ(Factor=addition)
Z_4 = UnitZ(Factor=floor_thickness_3)
addition_2 = Addition(A=floor_thickness_3, B=bottom_parts_thickness_2, C=pcb_thickness_2)
move = Move(Geometry=stand_offs, Motion=Z_4)  # -> Geometry, Transform
move_2 = Move(Geometry=case_shoulder_2, Motion=Z_3)  # -> Geometry, Transform
move_3 = Move(Geometry=pcb_shoulder_3, Motion=Z_4)  # -> Geometry, Transform
Z_5 = UnitZ(Factor=addition_2)
merge = Merge(Data1=move_3.Geometry, Data2=floor, Data3=move_2.Geometry, Data4=move.Geometry)  # -> flatten(Result)
move_4 = Move(Geometry=[trrs_cutout, usb_cutout], Motion=Z_5)  # -> Geometry, Transform
move_5 = Move(Geometry=shoulder_cutout_2, Motion=Z_4)  # -> Geometry, Transform
move_6 = Move(Geometry=thread_holes, Motion=Z_4)  # -> Geometry, Transform
sunion = SolidUnion(Breps=merge)
sdiff = SolidDifference(BrepsA=sunion, BrepsB=move_6.Geometry)
sdiff_2 = SolidDifference(BrepsA=sdiff, BrepsB=move_4.Geometry)
sdiff_3 = SolidDifference(BrepsA=sdiff_2, BrepsB=move_5.Geometry)
sdiff_4 = SolidDifference(BrepsA=sdiff_3, BrepsB=foot_cut_outs)
completed_case = Geometry(sdiff_4)

# ==== cluster OuterCaseOutline
case_tolerance = ClusterInput()
shoulder_width = ClusterInput()
pcb_outline = ClusterInput()
case_tolerance_2 = Number(case_tolerance)
shoulder_width_2 = Number(shoulder_width)
pcb_outline_2 = Curve(pcb_outline)
addition = Addition(A=shoulder_width_2, B=case_tolerance_2)
offset = OffsetCurve(Curve=pcb_outline_2, Distance=expr("-x", addition), Plane=PlaneXY(0, 0, 0), Corners=Slider(3, range=0..10))
C = ClusterOutput(offset)

# ==== cluster PCBShoulder
pcb_outline = ClusterInput()
pcb_shoulder = ClusterInput()
pcb_outline_2 = Curve(pcb_outline)
pcb_shoulder_2 = Number(pcb_shoulder)
outer_case_outline = ClusterInput()
outer_case_outline_2 = Geometry(outer_case_outline)
offset = OffsetCurve(Curve=pcb_outline_2, Distance=pcb_shoulder_2, Plane=PlaneXY(0, 0, 0), Corners=Slider(3, range=0..10))
boundary = BoundarySurfaces(Edges=offset)
boundary_2 = BoundarySurfaces(Edges=outer_case_outline_2)
bottom_parts_thickness = ClusterInput()
bottom_parts_thickness_2 = Number(bottom_parts_thickness)
rdiff = RegionDifference(CurvesA=boundary_2, CurvesB=boundary)
boundary_3 = BoundarySurfaces(Edges=rdiff)
Z = UnitZ(Factor=bottom_parts_thickness_2)
extr = Extrude(Base=boundary_3, Direction=Z)
E = ClusterOutput(extr)

# ==== cluster CaseShoulder
shoulder_height = ClusterInput()
outer_case_outline = ClusterInput()
case_tolerance = ClusterInput()
pcb_outline = ClusterInput()
pcb_thickness = ClusterInput()
shoulder_height_2 = Number(shoulder_height)
outer_case_outline_2 = Geometry(outer_case_outline)
case_tolerance_2 = Number(case_tolerance)
pcb_outline_2 = Curve(pcb_outline)
addition = Addition(A=shoulder_height_2, B=pcb_thickness)
offset = OffsetCurve(Curve=pcb_outline_2, Distance=expr("-x", case_tolerance_2), Plane=PlaneXY(0, 0, 0), Corners=1)
boundary = BoundarySurfaces(Edges=outer_case_outline_2)
boundary_2 = BoundarySurfaces(Edges=offset)
rdiff = RegionDifference(CurvesA=boundary, CurvesB=boundary_2)
boundary_3 = BoundarySurfaces(Edges=rdiff)
Z = UnitZ(Factor=addition)
extr = Extrude(Base=boundary_3, Direction=Z)
E = ClusterOutput(extr)

# ==== cluster Cluster
bottom_parts_thickness = ClusterInput()
standoff_diam = ClusterInput()
insert_tip_diam = ClusterInput()
thread_length = ClusterInput()
screw_centers = ClusterInput()
bottom_parts_thickness_2 = Number(bottom_parts_thickness)
standoff_diam_2 = Number(standoff_diam)
insert_tip_diam_2 = Number(insert_tip_diam)
thread_length_2 = Number(thread_length)
screw_centers_2 = Point(screw_centers)
cir = Circle(Plane=screw_centers_2, Radius=expr("x/2", standoff_diam_2))
cir_2 = Circle(Plane=screw_centers_2, Radius=expr("x/2", insert_tip_diam_2))
Z = UnitZ(Factor=bottom_parts_thickness_2)
boundary = BoundarySurfaces(Edges=cir)
boundary_2 = BoundarySurfaces(Edges=cir_2)
extr = Extrude(Base=boundary, Direction=Z)
move = Move(Geometry=boundary_2, Motion=Z)  # -> Geometry, Transform
Z_2 = UnitZ(Factor=thread_length_2)
E = ClusterOutput(extr)
extr_2 = Extrude(Base=move.Geometry, Direction=expr("-x", Z_2))
E_2 = ClusterOutput(extr_2)

# ==== cluster Cluster_2
bottom_parts_thickness = ClusterInput()
shoulder_cutout = ClusterInput()
bottom_parts_thickness_2 = Number(bottom_parts_thickness)
shoulder_cutout_2 = Geometry(shoulder_cutout)
boundary = BoundarySurfaces(Edges=shoulder_cutout_2)
Z = UnitZ(Factor=bottom_parts_thickness_2)
extr = Extrude(Base=boundary, Direction=Z)
E = ClusterOutput(extr)

# ==== cluster Cluster_3
trrs_z_offset = ClusterInput()
trrs_barrel_diam = ClusterInput()
ttrs_xy = ClusterInput()
trrs_z_offset_2 = Number(trrs_z_offset)
trrs_barrel_diam_2 = Number(trrs_barrel_diam)
ttrs_xy_2 = Point(ttrs_xy)
Z = UnitZ(Factor=trrs_z_offset_2)
X = UnitX(Factor=expr("-x", Slider(14, range=0..30)))
yz = YZPlane(Origin=ttrs_xy_2)
move = Move(Geometry=yz, Motion=X)  # -> Geometry, Transform
move_2 = Move(Geometry=move.Geometry, Motion=Z)  # -> Geometry, Transform
vec = VectorXYZ(
    XComponent=expr("-x/2", trrs_barrel_diam_2),
    YComponent=expr("-x/2", trrs_barrel_diam_2),
    ZComponent=expr("-x/2", trrs_barrel_diam_2))  # -> Vector, Length
rectangle = Rectangle(Plane=move_2.Geometry, XSize=trrs_barrel_diam_2, YSize=trrs_barrel_diam_2, Radius=0)  # -> Rectangle, Length
move_3 = Move(Geometry=rectangle.Rectangle, Motion=vec.Vector)  # -> Geometry, Transform
boxrec = BoxRectangle(Rectangle=move_3.Geometry, Height=Slider(30, range=0..100))
B = ClusterOutput(boxrec)

# ==== cluster Cluster_4
usb_width = ClusterInput()
usbz_offset = ClusterInput()
usb_height = ClusterInput()
usb_xy = ClusterInput()
usbz_offset_2 = Number(usbz_offset)
usb_height_2 = Number(usb_height)
usb_width_2 = Number(usb_width)
usb_xy_2 = Point(usb_xy)
xz = XZPlane(Origin=usb_xy_2)
Z = UnitZ(Factor=usbz_offset_2)
xy = XYPlane(Origin=usb_xy_2)
move = Move(Geometry=xy, Motion=Z)  # -> Geometry, Transform
box = CenterBox(Base=move.Geometry, X=expr("x/2", usb_width_2), Y=Slider(6, range=0..100), Z=expr("x/2", usb_height_2))
B = ClusterOutput(box)
